% Simulink data dictionary canrx_0x1BF.sldd

R64 = Simulink.AliasType(BaseType="double")
R32 = Simulink.AliasType(BaseType="single")
SD = Simulink.AliasType(BaseType="int32")
SW = Simulink.AliasType(BaseType="int16")
SB = Simulink.AliasType(BaseType="int8")
UD = Simulink.AliasType(BaseType="uint32")
UW = Simulink.AliasType(BaseType="uint16")
UB = Simulink.AliasType(BaseType="uint8")
BOOL = Simulink.AliasType(BaseType="boolean")
SI = Simulink.NumericType(DataTypeMode="Fixed-point: unspecified scaling", SignednessBool=true, WordLength=32, FixedExponent=0)
UI = Simulink.NumericType(DataTypeMode="Fixed-point: unspecified scaling", SignednessBool=false, WordLength=32, FixedExponent=0)
CH = Simulink.NumericType(DataTypeMode="Fixed-point: unspecified scaling", SignednessBool=true, WordLength=8, FixedExponent=0)
SO = Simulink.NumericType(DataTypeMode="Fixed-point: unspecified scaling", SignednessBool=true, WordLength=64, FixedExponent=0)
UO = Simulink.NumericType(DataTypeMode="Fixed-point: unspecified scaling", SignednessBool=false, WordLength=64, FixedExponent=0)
SLDD_CFG = Simulink.ConfigSet(StartTime="0", StopTime="10", Solver="FixedStepDiscrete", ProdHWDeviceType="Infineon->TriCore", SystemTargetFile="ert.tlc", TargetLang="C")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

canframe = Simulink.Bus(DataScope="Exported")
  canrx_0x1BF_reserve0: fixdt(0,8,0)
  can_gmlan_rx_trb_duty: fixdt(1,8,1,0), Min=-100, Max=100
  canrx_0x1BF_reserve1: fixdt(0,5,0)
  can_gmlan_rx_trb_power_off_enb_stat: fixdt(0,1,1,0), Min=0, Max=1
  can_gmlan_rx_trb_ctrl_enb_stat: fixdt(0,1,1,0), Min=0, Max=1
  canrx_0x1BF_reserve2: fixdt(0,8,0)
  can_gmlan_rx_vnt_act_pos: fixdt(0,10,0.1,0), Min=0, Max=100
  can_gmaln_rx_trb_err_msg: fixdt(0,16,1,0), Min=0, Max=65535
  canrx_0x1BF_reserve3: fixdt(0,8,0)