% Simulink data dictionary cantx_0x191.sldd

PLCANI_APCNTL_SET_INF_TYPE = enum(DefaultValue="PLCANI_APCNTL_SET_INF_2X")
  PLCANI_APCNTL_SET_INF_2X = 0
  PLCANI_APCNTL_SET_INF_4X = 1
  PLCANI_APCNTL_SET_INF_8X = 2
  PLCANI_APCNTL_SET_INF_16X = 3
  PLCANI_APCNTL_SET_INF_32X = 4
  PLCANI_APCNTL_SET_INF_128X = 5
  PLCANI_APCNTL_SET_INF_REF = 6
  PLCANI_APCNTL_SET_INF_256X = 10
  PLCANI_APCNTL_SET_INF_64X = 11
  PLCANI_APCNTL_SET_INF_25X = 13
  PLCANI_APCNTL_SET_INF_250X = 14

SLDD_CFG = Simulink.ConfigSet(StartTime="0", StopTime="10", Solver="FixedStepDiscrete", ProdHWDeviceType="Infineon->TriCore", SystemTargetFile="ert.tlc", TargetLang="C")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